# Dynamo graph SampleDynamoExport.dyn (Dynamo 1.2.1.3083)

boolean = BoolSelector(true)
directory_path = Directory("C:\Users\wwong\Desktop")
code_block = CodeBlock { "spectacles.json"; }
number_slider = DoubleSlider(1, range=0..100 step 0.1)
byLengths = Cuboid.ByLengths(width=number_slider, length=number_slider, height=number_slider)
sceneCompiler = Spectacles.DynamoExporter.Spectacles.SceneCompiler(boolean, directory_path, code_block, byLengths)
watch = Watch(sceneCompiler.out0)
watch_2 = Watch(sceneCompiler.out1)
